# Dynamo graph Material Quantification.dyn (Dynamo 2.19.3.6394)
# author: ADILLA
# WELCOME! We're glad to have you here.

# group: Floor Finishes
# This script captures the input parameters related to floor finishes. All measurements must be entered in millimeters (MM).
categories = Categories("OST_Rooms")
all_elements_of_category = ElementsOfCategory(Category=categories)
string = StringInput("Level")
getParameterValueByName = Element.GetParameterValueByName(element=all_elements_of_category, parameterName=string)
string_2 = StringInput("Name")
getParameterValueByName_2 = Element.GetParameterValueByName(element=all_elements_of_category, parameterName=string_2)
string_3 = StringInput("Area")
getParameterValueByName_3 = Element.GetParameterValueByName(element=all_elements_of_category, parameterName=string_3)
total_area_m2 = Math.Sum(values=getParameterValueByName_3)
# note: PLEASE ENTER VALUES IN MILIMETERS (MM) ONLY
floor_01_length_size_of_tiles = DoubleInput(300)  # graph input
code_block = CodeBlock { 1000; }
div = floor_01_length_size_of_tiles / code_block
floor_02_width_size_of_tiles = DoubleInput(300)  # graph input
div_2 = floor_02_width_size_of_tiles / code_block
mul = div * div_2
div_3 = total_area_m2 / mul
ceiling = Math.Ceiling(number=div_3)
floor_01_number_of_tiles = Watch(ceiling)
floor_03_cost_per_unit_rm = DoubleInput(1.7)  # graph input
mul_2 = floor_01_number_of_tiles * floor_03_cost_per_unit_rm
floor_02_total_cost_floor = Watch(mul_2)  # "(Floor) 02 Total Cost Floor Finishes (RM)"; graph output

# group: Floor Concrete
# This script defines the input values for floor concrete dimensions. All measurements must be entered in millimeters (MM).
categories_2 = Categories("OST_Floors")
all_elements_of_category_2 = ElementsOfCategory(Category=categories_2)
string_4 = StringInput("Volume")
getParameterValueByName_4 = Element.GetParameterValueByName(element=all_elements_of_category_2, parameterName=string_4)
number = DoubleInput(2)
round = Math.Round(number=getParameterValueByName_4, digits=number)
concrete_01_total_volume_of = Math.Sum(values=round)  # "(Concrete) 01 Total Volume of Concrete m³"; graph output
# note: PLEASE ENTER VOLUME VALUES IN METERS (M) ONLY
concrete_01_cost_per_volume_m³ = DoubleInput(236)  # "(Concrete) 01 Cost Per Volume m³ (RM)"; graph input
mul_3 = concrete_01_total_volume_of * concrete_01_cost_per_volume_m³
concrete_02_total_price_of = Watch(mul_3)  # "(Concrete) 02 Total Price of Concrete (RM)"; graph output

# group: Walls > Brick Parameters
# This script defines the standard dimensions of a brick used for wall construction.
# note: PLEASE ENTER VALUES IN MILIMETERS (MM) ONLY
wall_01_length_size_of_brick = DoubleInput(215)  # graph input
wall_02_width_size_of_brick_w = DoubleInput(100)  # graph input
wall_03_height_size_of_brick = DoubleInput(65)  # graph input

# group: Walls
# This group defines the wall size by specifying the brick length in millimeters (mm). Ensure that only numerical values are entered. The value set here will be used for wall dimension calculations in the model. All measurements must be entered in millimeters (MM).
categories_3 = Categories("OST_Walls")
all_elements_of_category_3 = ElementsOfCategory(Category=categories_3)
string_5 = StringInput("Area")
getParameterValueByName_5 = Element.GetParameterValueByName(element=all_elements_of_category_3, parameterName=string_5)
code_block_2 = CodeBlock { 1000; }
div_4 = wall_01_length_size_of_brick / code_block_2
div_5 = wall_02_width_size_of_brick_w / code_block_2
mul_4 = div_4 * div_5
div_6 = wall_03_height_size_of_brick / code_block_2
mul_5 = mul_4 * div_6
div_7 = getParameterValueByName_5 / mul_5
watch = Watch(div_7)
ceiling_2 = Math.Ceiling(number=watch)
wall_01_total_number_of_bricks = Math.Sum(values=ceiling_2)  # graph output
# note: DEFAULT OF TOTAL BRICKS BY PALLET IS 720pcs. USER MAY CHANGE THE VALUE
wall_04_total_bricks_by_pallet = DoubleInput(720)  # graph input
div_8 = wall_01_total_number_of_bricks / wall_04_total_bricks_by_pallet
wall_02_total_number_of_pallet = Math.Ceiling(number=div_8)  # graph output
# note: DEFAULT COST OF BRICK BY PALLET IS RM 374.40. USER MAY CHANGE THE VALUE
wall_05_total_cost_per_pallet_rm = DoubleInput(374.4)  # graph input
mul_6 = wall_02_total_number_of_pallet * wall_05_total_cost_per_pallet_rm
wall_03_total_cost_of_pallet = Watch(mul_6)  # "(Wall) 03 Total Cost of Pallet Brick (RM)"; graph output

# group: Windows
# This script is used to input the unit cost for door elements. The cost must be entered in the appropriate currency (RM)
categories_4 = Categories("OST_Windows")
all_elements_of_category_4 = ElementsOfCategory(Category=categories_4)
string_6 = StringInput("Family")
getParameterValueByName_6 = Element.GetParameterValueByName(element=all_elements_of_category_4, parameterName=string_6)
window_01_total_number_of_window = List.Count(list=getParameterValueByName_6)  # graph output
# note: DEFAULT OF COST WINDOW/UNIT IS RM 600. USER MAY CHANGE THE VALUE
window_01_cost_per_unit_rm = DoubleInput(600)  # graph input
mul_7 = window_01_total_number_of_window * window_01_cost_per_unit_rm
window_02_total_price_of_window = Watch(mul_7)  # "(Window) 02 Total Price of Window (RM)"; graph output

# group: Doors
# This script allows users to enter the unit cost for window elements. Make sure to input the cost in the correct currency format (MYR)
categories_5 = Categories("OST_Doors")
all_elements_of_category_5 = ElementsOfCategory(Category=categories_5)
string_7 = StringInput("Family")
getParameterValueByName_7 = Element.GetParameterValueByName(element=all_elements_of_category_5, parameterName=string_7)
door_01_total_number_of_door = List.Count(list=getParameterValueByName_7)  # graph output
# note: DEFAULT COST DOOR/UNIT IS RM 780. USER MAY CHANGE THE VALUE
door_01_cost_per_unit_rm = DoubleInput(780)  # graph input
mul_8 = door_01_total_number_of_door * door_01_cost_per_unit_rm
door_02_total_price_of_door_rm = Watch(mul_8)  # graph output

# group: Overall Total Material Cost
# This group calculates the total material cost by summing individual material costs from a list. Ensure that all cost values are correctly inputted in RM (Malaysian Ringgit) before running the script. The final total is displayed as the overall material cost for the project
list_create = List.Create(item0=concrete_02_total_price_of, item1=floor_02_total_cost_floor, item2=wall_03_total_cost_of_pallet, item3=window_02_total_price_of_window, item4=door_02_total_price_of_door_rm)
sum = Math.Sum(values=list_create)
overall_total_material_cost_rm = Watch(sum)  # graph output
